# Grasshopper definition Generate DA_local.gh (Grasshopper 1.0.7)
# plug-ins: TT Toolbox, Colibri

# ---- group: Pseudo Random Seed Value
seed = Slider(35, range=1..2000)

# ---- group: Randomized Inputs
rand = GhPythonScript(x=seed)  # -> S
# ---------- rand: Python ----------
"""Provides a scripting component.
    Inputs:
        x: seed
    Output:
        S: Random Seed"""

__author__ = "kenta"
__version__ = "2022.02.23"

import rhinoscriptsyntax as rs
import random

random.seed(x)
S = random.randrange(50000)
# ---------- end rand ----------

# ---- group: Randomized Inputs / Random Orientation from 0 to 360 degrees
multiplication = Multiplication(A=rand, _10=10)
rand_2 = GhPythonScript(x=multiplication)  # -> S; same code as rand
random = Random(Range="0 to 360", Number=1, Seed=rand_2)

# ---- group: Randomized Inputs / Random 4 sided polygon
multiplication_2 = Multiplication(A=rand, _18=18)
random_2 = Random(Range="0.25 to 1.0", Number="4", Seed=multiplication_2)
random_3 = Random(Range="4 to 7.5", Number=1, Seed=multiplication_2)
cir = Circle(Plane=PlaneXY(0, 0, 0), Radius=random_3)
ma = MassAddition(Input=random_2)  # -> Result, PartialResults
len = Length(Curve=cir)
division = Division(A=ma.PartialResults, B=ma.Result)
multiplication_3 = Multiplication(A=division, B=len)
eval = EvaluateLength(Curve=cir, Length=multiplication_3, Normalized=Toggle(False))  # -> Point, Tangent, Parameter
bang = ExplodeTree(Data=graft(eval.Point))  # -> Branch0, Branch1, Branch2, Branch3
srf4pt = _4PointSurface(CornerA=bang.Branch0, CornerB=bang.Branch1, CornerC=bang.Branch2, CornerD=bang.Branch3)

# ---- group: Randomized Inputs / Random Window Height from 0.2 to 0.95 ratio
multiplication_4 = Multiplication(A=rand, _76=76)
rand_3 = GhPythonScript(x=multiplication_4)  # -> S; same code as rand
random_4 = Random(Range="0.2 to 0.95", Number=1, Seed=rand_3)

# ---- group: Randomized Inputs / Random Room Height from 2 to 5m
multiplication_5 = Multiplication(A=rand, _34=34)
rand_4 = GhPythonScript(x=multiplication_5)  # -> S; same code as rand
random_5 = Random(Range="2 to 3.5", Number=1, Seed=rand_4)

# ---- group: Randomized Inputs / Random Window Width from 0.2 to 0.95 ratio
multiplication_6 = Multiplication(A=rand, _72=72)
rand_5 = GhPythonScript(x=multiplication_6)  # -> S; same code as rand
random_6 = Random(Range="0.2 to 0.95", Number=1, Seed=rand_5)

# ---- group: Create Data / Rotate model
xy = XYPlane(Origin=Point(0, 0, 0))
rad = Radians(Degrees=random)
rotate = Rotate(Geometry=srf4pt, Angle=rad, Plane=xy)  # -> Geometry, Transform

# ---- group: Create Data / Padded Grid
number_slider = Slider(30, range=0..1000)
brep = Brep(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)
boundary = BoundarySurfaces(Edges=brep)
mplane = MeshPlane(Boundary=boundary, WidthCount=number_slider, HeightCount=number_slider)  # -> Mesh, Area
facen = FaceNormals(Mesh=mplane.Mesh)  # -> Centers, Normals
incurves = PointInCurves(Point=facen.Centers, Curves=rotate.Geometry)  # -> Relationship, Index, Point
padding = GhPythonScript(x=incurves.Relationship)  # -> a; inputs x: list
# ---------- padding: Python ----------
__author__ = "karimd"
__version__ = "2021.11.06"

import rhinoscriptsyntax as rs

a = []

for i in x:
    if int(i) == 2:
        a.append(1)
    else:
        a.append(0)
# ---------- end padding ----------
cullf = CullFaces(Mesh=mplane.Mesh, Pattern=invert(padding))
cull = CullPattern(List=facen.Centers, CullPattern=padding)
Z = UnitZ(Factor=1)
lng = ListLength(List=cull)
dup = DuplicateData(Data=Z, Number=lng, Order=True)
sensorgrid = HBSensorGrid(name="AECTestGrid2", positions=cull, directions=dup, mesh=cullf)  # -> grid; plug-in component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

# ---- group: Create Data / Extrude Room Solid
vec = VectorXYZ(XComponent=0, YComponent=0, ZComponent=random_5)  # -> Vector, Length
extr = Extrude(Base=rotate.Geometry, Direction=vec.Vector)
roomsolid = HBRoomFromSolid(geo=flatten(extr), conditioned=True)  # -> report, rooms; plug-in component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

# ---- group: Create Data / Create window on one side
explode = Explode(Curve=rotate.Geometry, Recursive=True)  # -> Segments, Vertices
extr_2 = Extrude(Base=explode.Segments, Direction=vec.Vector)
item = ListItem(List=extr_2, Index=0, Wrap=True)
area = Area(Geometry=item)  # -> Area, Centroid
pl_origin = PlaneOrigin(Base=item, Origin=area.Centroid)
scale_nu = ScaleNU(Geometry=item, Plane=pl_origin, ScaleX=random_6, ScaleY=random_4, ScaleZ=1)  # -> Geometry, Transform
aperture = HBAperture(geo=scale_nu.Geometry)  # -> report, apertures; plug-in component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

# ---- group: Create Data / Room
addsubface = HBAddSubface(hb_obj=flatten(roomsolid.rooms), sub_faces=flatten(aperture.apertures))  # -> hb_obj; plug-in component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
vizbytype = HBVisualizeByType(hb_objs=addsubface)  # -> walls, interior_walls, roofs, ceilings, exterior_floors, interior_floors, air_walls, apertures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; plug-in component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

# ---- group: Create Data / Room coordinates
debrep = DeconstructBrep(Brep=rotate.Geometry)  # -> Faces, Edges, Vertices
panel = Panel(debrep.Vertices)
xy_coord = GhPythonScript(xyz=panel)  # -> out, xy; inputs xyz: list
# ---------- xy_coord: Python ----------
"""Provides a scripting component.
    Inputs:
        x: The x script variable
    Output:
        a: The a output variable"""

__author__ = "kenta"
__version__ = "2022.02.24"

import rhinoscriptsyntax as rs
import re

xy = []
for i in xyz:
    xy.append(float(re.search('{(.+?),', i).group(1)))
    xy.append(float(re.search(',(.+?),', i).group(1)))
# ---------- end xy_coord ----------
panel_2 = Panel(xy_coord.xy)
xy_coordinate = ExplodeTree(Data=graft(xy_coord.xy))  # -> _00000, _00001, _00002, _00003, _00004, _00005, _00006, _00007

# ---- group: Create Data / Honeybee Model
model = HBModel(rooms=flatten(addsubface))  # -> report, model; plug-in component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
panel_3 = Panel("https://climate.onebuilding.org/WMO_Region_6_Europe/DNK_Denmark/HS_Capital/DNK_HS_Copenhagen-Kastrup.AP.061800_TMYx.zip")
assigngridsviews = HBAssignGridsAndViews(model=model.model, grids=flatten(sensorgrid))  # -> model; plug-in component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
downloadepw = LBDownloadWeather(weather_URL=panel_3)  # -> epw_file, stat_file, ddy_file; plug-in component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

# ---- group: Create Data / Window Angle
facen_2 = FaceNormals(Mesh=vizbytype.apertures)  # -> Centers, Normals
xy_2 = XYPlane(Origin=Point(0, 0, 0))
Y = UnitY(Factor=1)
item_2 = ListItem(List=facen_2.Normals, Index=0, Wrap=True)
angle = Angle(VectorA=Y, VectorB=item_2, Plane=xy_2)  # -> Angle, Reflex
deg = Degrees(Radians=angle.Reflex)
panel_4 = Panel(deg)

# ---- group: Input Data
entwine = Entwine(
    Branch00=seed,
    Branch01=xy_coordinate._00000,
    Branch02=xy_coordinate._00001,
    Branch03=xy_coordinate._00002,
    Branch04=xy_coordinate._00003,
    Branch05=xy_coordinate._00004,
    Branch06=xy_coordinate._00005,
    Branch07=xy_coordinate._00006,
    Branch08=xy_coordinate._00007,
    Branch09=random_5,
    Branch010=random_6,
    Branch011=random_4,
    Branch012=panel_4,
    FlattenInputs=True)  # -> flatten(Result)
panel_5 = Panel(entwine)

# ---- group: Run
toggle = BooleanToggle(False)

# ----
annualdaylight = HBAnnualDaylight(model=assigngridsviews, wea=downloadepw.epw_file, run=toggle)  # -> report, results, DA, cDA, UDI, UDI_low, UDI_up; plug-in component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

apply_padding = GhPythonScript(padding=padding, DA=annualdaylight.DA)  # -> paddedDA; inputs padding: list, DA: list
# ---------- apply_padding: Python ----------
__author__ = "kenta"
__version__ = "2022.02.24"

import rhinoscriptsyntax as rs

n=0

for i,item in enumerate(padding):
    if item == 1:
        padding[i]=DA[n]
        n+=1

paddedDA = padding
# ---------- end apply_padding ----------
panel_6 = Panel(apply_padding)

apply_padding_2 = GhPythonScript(padding=padding, UDI=annualdaylight.UDI)  # -> paddedUDI; inputs padding: list, UDI: list
# ---------- apply_padding_2: Python ----------
__author__ = "kenta"
__version__ = "2022.02.24"

import rhinoscriptsyntax as rs

n=0

for i,item in enumerate(padding):
    if item == 1:
        padding[i]=UDI[n]
        n+=1

paddedUDI = padding
# ---------- end apply_padding_2 ----------
panel_7 = Panel(apply_padding_2)

merge = Merge(
    Data1="Seed",
    Data2="x1",
    Data3="y1",
    Data4="x2",
    Data5="y2",
    Data6="x3",
    Data7="y3",
    Data8="x4",
    Data9="y4",
    Data10="RoomHeight",
    Data11="WindowWidth",
    Data12="WindowHeight",
    Data13="WindowOrientation")  # -> simplify(flatten(Result))

# ---- group: Test UDI
legendpar = LBLegendParameters(max="100")  # -> leg_par; plug-in component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

# ---- group: Write to Excel
addition = Addition(A=seed, B=1)
toggle_2 = BooleanToggle(False)
iterator = ColibriIterator(Seed=seed, RemoteFly=False, ignoreAllWarningMsg=False)  # -> Value, Value_N, IterationGenome
wo = WriteOptions(
    FilePath="C:\Users\kenta\Desktop\Output\InstantDaylight.xlsx",
    ClearDataOverwrite=Toggle(False),
    SaveAfterWrite=False,
    CloseAfterWrite=False,
    ColumnStartPosition=1,
    RowStartPosition=addition)  # -> UserMessages, WriteOptions
writexl = WriteToExcel(Run=toggle_2, ExcelWorksheet="3", WriteOptions=wo.WriteOptions, ColumnnsOrRows=True, DataToWriteIntoColumns=panel_7)
writexl_2 = WriteToExcel(Run=toggle_2, ExcelWorksheet="1", WriteOptions=wo.WriteOptions, ColumnnsOrRows=True, DataToWriteIntoColumns=panel_5)
writexl_3 = WriteToExcel(Run=toggle_2, ExcelWorksheet="2", WriteOptions=wo.WriteOptions, ColumnnsOrRows=True, DataToWriteIntoColumns=panel_6)

# ---- group: Test UDI / Visualize
vizwiref = HBVizualizeWireframe(hb_objs=flatten(addsubface))  # -> geo; plug-in component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
heatmap = LBSpatialHeatmap(values=panel_6, mesh=mplane.Mesh, legend_par=legendpar)  # -> mesh, legend, title, colors, legend_par; plug-in component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
preview = CustomPreview(Geometry=vizwiref, Material=ColourSwatch(SwatchColor=RGB(0, 0, 0)))
