# Grasshopper definition Generate DA_pollinate.gh (Grasshopper 1.0.7)
# plug-ins: TT Toolbox, Colibri, PollinationGH

# ---- group: Index
index = Slider(3, range=0..199)

# ---- group: Pseudo Random Seed Value
seed = Slider(200, range=1..200)

# ----
check_job_status = CheckJobStatus(
    _job="kentakahas/demo/20fc8058-55b0-4ce5-a6ac-bcf9b0728487",
    Index_=index,
    getBothInputOutputAssets=False,
    liveUpdateStatus=False)

# ---- group: Randomized Inputs
rand = GhPythonScript(x=seed)  # -> S
# ---------- rand: Python ----------
"""Provides a scripting component.
    Inputs:
        x: seed
    Output:
        S: Random Seed"""

__author__ = "kenta"
__version__ = "2022.02.23"

import rhinoscriptsyntax as rs
import random

random.seed(x)
S = random.randrange(50000)
# ---------- end rand ----------

# ---- group: Write Data / Read Pollination Results
check_run_inputs = CheckRunInputs(
    _run=check_job_status,
    recipeSource="https://api.pollination.cloud/registries/ladybug-tools/recipe/annual-daylight/0.8.12-viz")  # -> PaddingGrid, RoomHeight, Seed, WindowHeight, WindowOrientation, WindowWidth, CpuCount, GridFilter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
check_run_results = CheckRunResults(
    _run=check_job_status,
    recipeSource="https://api.pollination.cloud/registries/ladybug-tools/recipe/annual-daylight/0.8.12-viz")  # -> CDA, DA, Metrics, Results, Results_direct, UDI, UDI_low, UDI_up, Visualization
load_assets = LoadAssets(Asset_1=check_run_inputs.Model, liveUpdateStatus=False, postprocessWithHandler=True, useCachedAssets=True)  # -> Logs, Value_1
load_assets_2 = LoadAssets(
    DA=check_run_results.DA,
    UDI=check_run_results.UDI,
    liveUpdateStatus=False,
    postprocessWithHandler=True,
    useCachedAssets=True)  # -> Logs, DA, UDI, Value_3
panel = Panel(check_run_inputs.Seed)

# ---- group: Randomized Inputs / Random Orientation from 0 to 360 degrees
multiplication = Multiplication(A=rand, _10=10)
rand_2 = GhPythonScript(x=multiplication)  # -> S; same code as rand
random = Random(Range="0 to 360", Number=1, Seed=rand_2)

# ---- group: Randomized Inputs / Random Window Height from 0.2 to 0.95 ratio
multiplication_2 = Multiplication(A=rand, _76=76)
rand_3 = GhPythonScript(x=multiplication_2)  # -> S; same code as rand
random_2 = Random(Range="0.2 to 0.95", Number=1, Seed=rand_3)

# ---- group: Randomized Inputs / Random Room Height from 2 to 5m
multiplication_3 = Multiplication(A=rand, _34=34)
rand_4 = GhPythonScript(x=multiplication_3)  # -> S; same code as rand
random_3 = Random(Range="2 to 3.5", Number=1, Seed=rand_4)

# ---- group: Randomized Inputs / Random Window Width from 0.2 to 0.95 ratio
multiplication_4 = Multiplication(A=rand, _72=72)
rand_5 = GhPythonScript(x=multiplication_4)  # -> S; same code as rand
random_4 = Random(Range="0.2 to 0.95", Number=1, Seed=rand_5)

# ---- group: Randomized Inputs / Random 4 sided polygon
multiplication_5 = Multiplication(A=rand, _18=18)
random_5 = Random(Range="0.25 to 1.0", Number="4", Seed=multiplication_5)
random_6 = Random(Range="4 to 7.5", Number=1, Seed=multiplication_5)
cir = Circle(Plane=PlaneXY(0, 0, 0), Radius=random_6)
ma = MassAddition(Input=random_5)  # -> Result, PartialResults
len = Length(Curve=cir)
division = Division(A=ma.PartialResults, B=ma.Result)
multiplication_6 = Multiplication(A=division, B=len)
eval = EvaluateLength(Curve=cir, Length=multiplication_6, Normalized=Toggle(False))  # -> Point, Tangent, Parameter
bang = ExplodeTree(Data=graft(eval.Point))  # -> Branch0, Branch1, Branch2, Branch3
srf4pt = _4PointSurface(CornerA=bang.Branch0, CornerB=bang.Branch1, CornerC=bang.Branch2, CornerD=bang.Branch3)

# ---- group: Write Data / Input Data
entwine = Entwine(
    Branch00=panel,
    Branch01=check_run_inputs.X1,
    Branch02=check_run_inputs.Y1,
    Branch03=check_run_inputs.X2,
    Branch04=check_run_inputs.Y2,
    Branch05=check_run_inputs.X3,
    Branch06=check_run_inputs.Y3,
    Branch07=check_run_inputs.X4,
    Branch08=check_run_inputs.Y4,
    Branch09=check_run_inputs.RoomHeight,
    Branch010=check_run_inputs.WindowWidth,
    Branch011=check_run_inputs.WindowHeight,
    Branch012=check_run_inputs.WindowOrientation,
    FlattenInputs=True)  # -> flatten(Result)
panel_2 = Panel(entwine)

# ---- group: Write Data / Output Data
unzip = GhPythonScript(CompMtx=check_run_inputs.PaddingGrid)  # -> DecompMtx
# ---------- unzip: Python ----------
DecompMtx = list(int(i) for i in bin(int(CompMtx)).replace('0b','').zfill(1600))
# ---------- end unzip ----------
apply_padding = GhPythonScript(padding=unzip, UDI=load_assets_2.UDI)  # -> paddedUDI; inputs padding: list, UDI: list
# ---------- apply_padding: Python ----------
__author__ = "kenta"
__version__ = "2022.02.24"

import rhinoscriptsyntax as rs

n=0

for i,item in enumerate(padding):
    if item == 1:
        padding[i]=UDI[n]
        n+=1

paddedUDI = padding
# ---------- end apply_padding ----------
apply_padding_2 = GhPythonScript(padding=unzip, DA=load_assets_2.DA)  # -> paddedDA; inputs padding: list, DA: list
# ---------- apply_padding_2: Python ----------
__author__ = "kenta"
__version__ = "2022.02.24"

import rhinoscriptsyntax as rs

n=0

for i,item in enumerate(padding):
    if item == 1:
        padding[i]=DA[n]
        n+=1

paddedDA = padding
# ---------- end apply_padding_2 ----------
panel_3 = Panel(apply_padding)
panel_4 = Panel(apply_padding_2)

# ---- group: Write to Excel
addition = Addition(A=panel, B=1)
toggle = BooleanToggle(False)
wo = WriteOptions(
    FilePath="C:\Users\kenta\Desktop\Output\InstantDaylight.xlsx",
    ClearDataOverwrite=Toggle(False),
    SaveAfterWrite=False,
    CloseAfterWrite=False,
    ColumnStartPosition=1,
    RowStartPosition=addition)  # -> UserMessages, WriteOptions
iterator = ColibriIterator(Index_=index, RemoteFly=False, ignoreAllWarningMsg=False)  # -> Index_, IterationGenome
writexl = WriteToExcel(Run=toggle, ExcelWorksheet="1", WriteOptions=wo.WriteOptions, ColumnnsOrRows=True, DataToWriteIntoColumns=panel_2)
writexl_2 = WriteToExcel(Run=toggle, ExcelWorksheet="2", WriteOptions=wo.WriteOptions, ColumnnsOrRows=True, DataToWriteIntoColumns=panel_4)
writexl_3 = WriteToExcel(Run=toggle, ExcelWorksheet="3", WriteOptions=wo.WriteOptions, ColumnnsOrRows=True, DataToWriteIntoColumns=panel_3)

# ---- group: Create Data / Rotate model
xy = XYPlane(Origin=Point(0, 0, 0))
rad = Radians(Degrees=random)
rotate = Rotate(Geometry=srf4pt, Angle=rad, Plane=xy)  # -> Geometry, Transform

# ---- group: Create Data / Extrude Room Solid
vec = VectorXYZ(XComponent=0, YComponent=0, ZComponent=random_3)  # -> Vector, Length
extr = Extrude(Base=rotate.Geometry, Direction=vec.Vector)
roomsolid = HBRoomFromSolid(geo=flatten(extr), conditioned=True)  # -> report, rooms; plug-in component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

# ---- group: Create Data / Create window on one side
explode = Explode(Curve=rotate.Geometry, Recursive=True)  # -> Segments, Vertices
extr_2 = Extrude(Base=explode.Segments, Direction=vec.Vector)
item = ListItem(List=extr_2, Index=0, Wrap=True)
area = Area(Geometry=item)  # -> Area, Centroid
pl_origin = PlaneOrigin(Base=item, Origin=area.Centroid)
scale_nu = ScaleNU(Geometry=item, Plane=pl_origin, ScaleX=random_4, ScaleY=random_2, ScaleZ=1)  # -> Geometry, Transform
aperture = HBAperture(geo=scale_nu.Geometry)  # -> report, apertures; plug-in component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

# ---- group: Create Data / Extract Curve
edges = BrepEdges(Brep=rotate.Geometry)  # -> Naked, Interior, NonManifold
join = JoinCurves(Curves=edges.Naked, Preserve=False)
panel_5 = Panel("""0
1
2
3""")
eval_2 = EvaluateCurve(Curve=join, Parameter=panel_5)  # -> Point, Tangent, Angle

# ---- group: Create Data / Padded Grid
number_slider = Slider(30, range=0..1000)
brep = Brep(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)
boundary = BoundarySurfaces(Edges=brep)
mplane = MeshPlane(Boundary=boundary, WidthCount=number_slider, HeightCount=number_slider)  # -> Mesh, Area
facen = FaceNormals(Mesh=mplane.Mesh)  # -> Centers, Normals
incurves = PointInCurves(Point=facen.Centers, Curves=join)  # -> Relationship, Index, Point
python = GhPythonScript(x=incurves.Relationship)  # -> out, a; inputs x: list
# ---------- python: Python ----------
__author__ = "karimd"
__version__ = "2021.11.06"

import rhinoscriptsyntax as rs

a = []

for i in x:
    if int(i) == 2:
        a.append(1)
    else:
        a.append(0)
# ---------- end python ----------
cullf = CullFaces(Mesh=mplane.Mesh, Pattern=invert(python.a))
cull = CullPattern(List=facen.Centers, CullPattern=python.a)
Z = UnitZ(Factor=1)
lng = ListLength(List=cull)
dup = DuplicateData(Data=Z, Number=lng, Order=True)
sensorgrid = HBSensorGrid(name="AECTestGrid2", positions=cull, directions=dup, mesh=cullf)  # -> grid; plug-in component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

# ---- group: Visualize
legendpar = LBLegendParameters(min="0", max="100")  # -> leg_par; plug-in component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
loadobjects = HBLoadObjects(hb_file=load_assets.Value_1, load=Toggle(True))  # -> report, hb_objs; plug-in component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
vizwiref = HBVizualizeWireframe(hb_objs=flatten(loadobjects.hb_objs))  # -> geo; plug-in component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
heatmap = LBSpatialHeatmap(values=panel_4, mesh=mplane.Mesh, legend_par=legendpar)  # -> mesh, legend, title, colors, legend_par; plug-in component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
preview = CustomPreview(Geometry=vizwiref, Material=ColourSwatch(SwatchColor=RGB(0, 0, 0)))

# ---- group: Create Data / Room
addsubface = HBAddSubface(hb_obj=flatten(roomsolid.rooms), sub_faces=flatten(aperture.apertures))  # -> hb_obj; plug-in component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
vizbytype = HBVisualizeByType(hb_objs=addsubface)  # -> walls, interior_walls, roofs, ceilings, exterior_floors, interior_floors, air_walls, apertures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; plug-in component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

# ---- group: Capture Image
concat = Concatenate(FragmentA="simulate_", FragmentB=panel)
captureview = LBCaptureView(
    file_name=concat,
    folder="C:\Users\kenta\Desktop\Output\Simulation Images",
    transparent=Toggle(False),
    capture=Toggle(False))  # -> file; plug-in component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

# ---- group: Create Data / Room coordinates
panel_6 = Panel(eval_2.Point)
xy_coord = GhPythonScript(xyz=panel_6)  # -> out, xy; inputs xyz: list
# ---------- xy_coord: Python ----------
"""Provides a scripting component.
    Inputs:
        x: The x script variable
    Output:
        a: The a output variable"""

__author__ = "kenta"
__version__ = "2022.02.24"

import rhinoscriptsyntax as rs
import re

xy = []
for i in xyz:
    xy.append(float(re.search('{(.+?),', i).group(1)))
    xy.append(float(re.search(',(.+?),', i).group(1)))
# ---------- end xy_coord ----------
panel_7 = Panel(xy_coord.xy)
xy_coordinate = ExplodeTree(Data=graft(xy_coord.xy))  # -> _000000, _000001, _000002, _000003, _000004, _000005, _000006, _000007

# ---- group: Create Data / Honeybee Model
model = HBModel(rooms=flatten(addsubface))  # -> report, model; plug-in component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
panel_8 = Panel("https://climate.onebuilding.org/WMO_Region_6_Europe/DNK_Denmark/HS_Capital/DNK_HS_Copenhagen-Kastrup.AP.061800_TMYx.zip")
assigngridsviews = HBAssignGridsAndViews(model=model.model, grids=flatten(sensorgrid))  # -> model; plug-in component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
downloadepw = LBDownloadWeather(weather_URL=panel_8)  # -> epw_file, stat_file, ddy_file; plug-in component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

# ---- group: Create Data / Window Angle
facen_2 = FaceNormals(Mesh=vizbytype.apertures)  # -> Centers, Normals
xy_2 = XYPlane(Origin=Point(0, 0, 0))
Y = UnitY(Factor=1)
item_2 = ListItem(List=facen_2.Normals, Index=0, Wrap=True)
angle = Angle(VectorA=Y, VectorB=item_2, Plane=xy_2)  # -> Angle, Reflex
deg = Degrees(Radians=angle.Reflex)
panel_9 = Panel(deg)

# ---- group: Compress padding to number
zip = GhPythonScript(Padding=python.a)  # -> CompMtx; inputs Padding: list
# ---------- zip: Python ----------
CompMtx = str(int(''.join(str(j) for j in Padding),2))
# ---------- end zip ----------

# ---- group: Test UDI / Run
toggle_2 = BooleanToggle(False)

# ---- group: Test UDI
annualdaylight = HBAnnualDaylight(model=assigngridsviews, wea=downloadepw.epw_file, run=toggle_2)  # -> report, results, DA, cDA, UDI, UDI_low, UDI_up; plug-in component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

# ---- group: Test UDI / Visualize
vizwiref_2 = HBVizualizeWireframe(hb_objs=flatten(addsubface))  # -> geo; plug-in component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
heatmap_2 = LBSpatialHeatmap(values=annualdaylight.UDI, mesh=cullf, legend_par=legendpar)  # -> mesh, legend, title, colors, legend_par; plug-in component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
preview_2 = CustomPreview(Geometry=vizwiref_2, Material=ColourSwatch(SwatchColor=RGB(0, 0, 0)))

# ---- group: Pollination / Colibri
iterator_2 = ColibriIterator(Seed=seed, RemoteFly=False, ignoreAllWarningMsg=False)  # -> Value, Value_N, IterationGenome

# ---- group: Pollination
user_inputs = UserInputs(
    Seed=seed,
    x1=xy_coordinate._000000,
    y1=xy_coordinate._000001,
    x2=xy_coordinate._000002,
    y2=xy_coordinate._000003,
    x3=xy_coordinate._000004,
    y3=xy_coordinate._000005,
    x4=xy_coordinate._000006,
    y4=xy_coordinate._000007,
    RoomHeight=random_3,
    WindowWidth=random_4,
    WindowHeight=random_2,
    WindowOrientation=panel_9,
    PaddingGrid=zip)
setup_runs = SetupRuns(
    _model=assigngridsviews,
    _wea=downloadepw.epw_file,
    Cpu_count_=50,
    Grid_filter_="*",
    Min_sen_count_=200,
    North_="0",
    Radiance_par_="-ab 2 -ad 5000 -lw 2e-05",
    Thresholds_="-t 300 -lt 100 -ut 3000",
    _user_inputs_=user_inputs,
    Owner="ladybug-tools",
    RecipeJsonString="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",
    project="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")

rec = DataRecorder(setup_runs, DataLimit=-10, RecordData=False)
pollinate = Pollinate(
    _runs=flatten(rec),
    _name_="InstantDaylightRerun01",
    Description_="Rerun of MLuminance with different inputs",
    Sub_folder_="TrainingData",
    CPUNumber=10,
    IfEnabledRemoteRun=False,
    RunLocal=False,
    liveUpdateStatus=True)

panel_10 = Panel(rec)
