# Grasshopper definition InstantDaylight.gh (Grasshopper 1.0.7)
# plug-ins: Hops

# ---- group: Input Data
window_side_index = Slider(2, range=0..3)
room_height = Slider(2.683, range=2..3.5)
window_height_ratio = Slider(0.491, range=0.25..0.95)
room_curve = Curve(<curve referenced from the Rhino model>)
window_width_ratio = Slider(0.696, range=0.25..0.95)

# ---- group: Extrude Room Solid
cir = Circle(Plane=PlaneXY(0, 0, 0), Radius=1)
flip = FlipCurve(Curve=cir)  # -> Curve, Flag
flip_2 = FlipCurve(Curve=room_curve, Guide=flip.Curve)  # -> Curve, Flag
B = BoundarySurfaces(Edges=flip_2.Curve)
vec = VectorXYZ(XComponent=0, YComponent=0, ZComponent=room_height)  # -> Vector, Length
extr = Extrude(Base=B, Direction=vec.Vector)

# ---- group: Create window on one side
explode = Explode(Curve=B, Recursive=True)  # -> Segments, Vertices
extr_2 = Extrude(Base=explode.Segments, Direction=vec.Vector)
item = ListItem(List=extr_2, Index=window_side_index, Wrap=True)
area = Area(Geometry=item)  # -> Area, Centroid
pl_origin = PlaneOrigin(Base=item, Origin=area.Centroid)
scale_nu = ScaleNU(Geometry=item, Plane=pl_origin, ScaleX=window_width_ratio, ScaleY=window_height_ratio, ScaleZ=1)  # -> Geometry, Transform

# ---- group: Window Orientation
xy = XYPlane(Origin=Point(0, 0, 0))
Y = UnitY(Factor=1)
angle = Angle(VectorA=Y, VectorB=pl_origin, Plane=xy)  # -> Angle, Reflex
deg = Degrees(Radians=angle.Reflex)

# ---- group: XY coordinates
debrep = DeconstructBrep(Brep=B)  # -> Faces, Edges, Vertices
pflip = FlipPlane(Plane=PlaneXY(0, 0, 0), ReverseX=False, ReverseY=False, SwapAxes=True)
rotate = Rotate(Geometry=cir, Angle=expr("x+1.5*pi", angle.Reflex), Plane=pflip)  # -> Geometry, Transform
alongcrv = SortAlongCurve(Points=debrep.Vertices, Curve=rotate.Geometry)  # -> Points, Indices
panel = Panel(alongcrv.Points)
xy_coord = GhPythonScript(xyz=panel)  # -> out, xy; inputs xyz: list
# ---------- xy_coord: Python ----------
"""Provides a scripting component.
    Inputs:
        x: The x script variable
    Output:
        a: The a output variable"""

__author__ = "kenta"
__version__ = "2022.02.24"

import rhinoscriptsyntax as rs
import re

xy = []
for i in xyz:
    xy.append(float(re.search('{(.+?),', i).group(1)))
    xy.append(float(re.search(',(.+?),', i).group(1)))
# ---------- end xy_coord ----------
xy_coordinate = ExplodeTree(Data=graft(xy_coord.xy))  # -> _0000, _0001, _0002, _0003, _0004, _0005, _0006, _0007

# ----
instant_daylight_autonomy = Hops(
    X1=xy_coordinate._0000,
    Y1=xy_coordinate._0001,
    X2=xy_coordinate._0002,
    Y2=xy_coordinate._0003,
    X3=xy_coordinate._0004,
    Y3=xy_coordinate._0005,
    X4=xy_coordinate._0006,
    Y4=xy_coordinate._0007,
    RoomHeight=room_height,
    WindowWidth=window_width_ratio,
    WindowHeight=window_height_ratio,
    WindowOrientation=deg,
    CacheResultsInMemory=False,
    CacheSolveResults=False,
    RemoteDefinitionLocation="http://127.0.0.1:5000/instantda",
    RemoteSolveVersion=(0, 1, 0),
    ShowInput_Enabled=False,
    ShowInput_Path=False,
    SynchronousSolve=True)

legendpar = LBLegendParameters(min="0", max="100")  # -> leg_par; plug-in component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

mesh_data = MeshData(C=room_curve, x=instant_daylight_autonomy)  # -> R, M

panel_2 = Panel("""Daylight Autonomy
Copenhagen-Kastrup AP""")
heatmap = LBSpatialHeatmap(
    values=mesh_data.R,
    mesh=mesh_data.M,
    offset_dom="-0.8 to -0.8",
    legend_par=legendpar,
    legend_title="DA (%)",
    global_title=panel_2)  # -> mesh, legend, title, colors, legend_par; plug-in component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

# ---- group: View Room
wires = BrepWireframe(Brep=extr, Density=-1)
preview = CustomPreview(Geometry=scale_nu.Geometry, Material=ColourSwatch(SwatchColor=RGBA(51, 214, 255, 133)))
preview_2 = CustomPreview(Geometry=wires, Material=ColourSwatch(SwatchColor=RGB(0, 0, 0)))

# ---- group: Orgin
origin = Curve([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])
preview_3 = CustomPreview(Geometry=origin, Material=ColourSwatch(SwatchColor=RGBA(84, 84, 84, 63)))

# ==== cluster MeshData
x = ClusterInput()
check = GhPythonScript(x=x)  # -> a
# ---------- check: Python ----------
__author__ = "kenta"
__version__ = "2022.03.10"

import rhinoscriptsyntax as rs

if x == None:
    a= [0]*900
else:
    a=x
# ---------- end check ----------
number_slider = Slider(30, range=0..1000)
brep = Brep(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)
boundary = BoundarySurfaces(Edges=brep)
mplane = MeshPlane(Boundary=boundary, WidthCount=number_slider, HeightCount=number_slider)  # -> Mesh, Area
C = ClusterInput()
facen = FaceNormals(Mesh=mplane.Mesh)  # -> Centers, Normals
incurves = PointInCurves(Point=facen.Centers, Curves=C)  # -> Relationship, Index, Point
python = GhPythonScript(x=incurves.Relationship)  # -> out, a; inputs x: list
# ---------- python: Python ----------
__author__ = "karimd"
__version__ = "2021.11.06"

import rhinoscriptsyntax as rs

a = []

for i in x:
    if int(i) == 2:
        a.append(1)
    else:
        a.append(0)
# ---------- end python ----------
multiplication = Multiplication(A=python.a, B=check)
R = ClusterOutput(multiplication)
M = ClusterOutput(mplane.Mesh)
